# Grasshopper definition Assignment-01_Grasshopper_Building_Model.gh (Grasshopper 1.0.8)
# plug-ins: LunchBox

button = Button()

pipeline = GeometryPipeline(
    GroupByLayer=False,
    GroupByType=False,
    IncludeHidden=True,
    IncludeLocked=True,
    LayerFilter="walls",
    NameFilter="*",
    SublayerFiltering=True,
    TypeFilter=4)
walls = Curve(pipeline)
boundary = BoundarySurfaces(Edges=walls)
graft = GraftTree(Tree=walls, IncludeEmptyLists=True, IncludeNullItems=True)

Z = UnitZ(Factor="3")
move = Move(Geometry=walls, Motion=Z)  # -> graft(Geometry), Transform

fmerge = MergeFaces(Brep=boundary)  # -> Breps, Before, After
mesh = MeshBrep(
    Brep=fmerge.Breps,
    Settings={GridMaxCount=0, GridMinCount=16, JaggedSeams=False, MaxEdgeLength=0, MinEdgeLength=0.0001, MinTolerance=0, Refine=True, RefineAngle=0, RelativeTolerance=0.65, SimplePlanes=True, Tolerance=0})

loft = Loft(
    Curves=[graft, move.Geometry],
    Options={Adjust=False, Closed=False, LoftEnds=0, LoftSimp=0, LoftType=0, Rebuild=10, Refit=0.01})
move_2 = Move(Geometry=mesh, Motion=Z)  # -> graft(Geometry), Transform

smesh = SimpleMesh(Brep=loft)
merge = Merge(Data1=smesh, Data2=mesh, Data3=move_2.Geometry)  # -> flatten(Result)

panel = Panel("E:\IAAC Local GIT Repositories\Graph ML - Environment\Assets")
save = ObjectSave(
    BakeToggle=button,
    FileDirectory=panel,
    FileName="Assignment-01_Grasshopper_Walls_Auto.obj",
    GeometryObjects=flatten(merge),
    Layer="obj_walls",
    ObjectName="GH_Obj",
    ObjectColor=RGB(255, 255, 255),
    LayerColor=RGB(255, 255, 255))

pipeline_2 = GeometryPipeline(
    GroupByLayer=False,
    GroupByType=False,
    IncludeHidden=True,
    IncludeLocked=True,
    LayerFilter="doors",
    NameFilter="*",
    SublayerFiltering=True,
    TypeFilter=4)

Z_2 = UnitZ(Factor="2")
move_3 = Move(Geometry=pipeline_2, Motion=Z_2)  # -> graft(Geometry), Transform
graft_2 = GraftTree(Tree=pipeline_2, IncludeEmptyLists=True, IncludeNullItems=True)
loft_2 = Loft(
    Curves=[graft_2, move_3.Geometry],
    Options={Adjust=False, Closed=False, LoftEnds=0, LoftSimp=0, LoftType=0, Rebuild=10, Refit=0.01})

smesh_2 = SimpleMesh(Brep=loft_2)

panel_2 = Panel("E:\IAAC Local GIT Repositories\Graph ML - Environment\Assets")
save_2 = ObjectSave(
    BakeToggle=button,
    FileDirectory=panel_2,
    FileName="Assignment-01_Grasshopper_Doors_Auto.obj",
    GeometryObjects=flatten(smesh_2),
    Layer="obj_doors",
    ObjectName="GH_Obj",
    ObjectColor=RGB(255, 255, 255),
    LayerColor=RGB(255, 255, 255))

pipeline_3 = GeometryPipeline(
    GroupByLayer=False,
    GroupByType=False,
    IncludeHidden=True,
    IncludeLocked=True,
    LayerFilter="windows",
    NameFilter="*",
    SublayerFiltering=True,
    TypeFilter=4)

Z_3 = UnitZ(Factor=1)
move_4 = Move(Geometry=pipeline_3, Motion=Z_3)  # -> Geometry, Transform

move_5 = Move(Geometry=move_4.Geometry, Motion=Z_3)  # -> graft(Geometry), Transform
graft_3 = GraftTree(Tree=move_4.Geometry, IncludeEmptyLists=True, IncludeNullItems=True)
loft_3 = Loft(
    Curves=[graft_3, move_5.Geometry],
    Options={Adjust=False, Closed=False, LoftEnds=0, LoftSimp=0, LoftType=0, Rebuild=10, Refit=0.01})

smesh_3 = SimpleMesh(Brep=loft_3)

panel_3 = Panel("E:\IAAC Local GIT Repositories\Graph ML - Environment\Assets")
save_3 = ObjectSave(
    BakeToggle=button,
    FileDirectory=panel_3,
    FileName="Assignment-01_Grasshopper_Windows_Auto.obj",
    GeometryObjects=flatten(smesh_3),
    Layer="obj_windows",
    ObjectName="GH_Obj",
    ObjectColor=RGB(255, 255, 255),
    LayerColor=RGB(255, 255, 255))
