# Grasshopper definition Point_tags.gh (Grasshopper 1.0.8)

_3 = Point([<point referenced from the Rhino model> x24])
_2 = Point([<point referenced from the Rhino model> x32])
_1 = Point([<point referenced from the Rhino model> x3])
pdecon = Deconstruct(Point=_3)  # -> XComponent, YComponent, ZComponent
pdecon_2 = Deconstruct(Point=_2)  # -> XComponent, YComponent, ZComponent
pdecon_3 = Deconstruct(Point=_1)  # -> XComponent, YComponent, ZComponent

concat = Concatenate(FragmentA=pdecon.XComponent, FragmentC=", ", FragmentB=pdecon.YComponent, FragmentD=", ", FragmentE=pdecon.ZComponent)
concat_2 = Concatenate(
    FragmentA=pdecon_2.XComponent,
    FragmentC=", ",
    FragmentB=pdecon_2.YComponent,
    FragmentD=", ",
    FragmentE=pdecon_2.ZComponent)
concat_3 = Concatenate(
    FragmentA=pdecon_3.XComponent,
    FragmentC=", ",
    FragmentB=pdecon_3.YComponent,
    FragmentD=", ",
    FragmentE=pdecon_3.ZComponent)
panel = Panel(concat)
panel_2 = Panel(concat_2)
panel_3 = Panel(concat_3)
